% Simulink data dictionary MotionPlanner_ExternalData.sldd

busMotionPlannerIn = Simulink.Bus()
  enablePlanner: boolean
  maxDeviationToReset: Bus: busMotionPlannerIn_maxDeviationToReset
  navigation: Bus: busMotionPlannerIn_navigation
  goal: Bus: busMotionPlannerIn_goal
  map: Bus: busMotionPlannerIn_map
  parameter: Bus: busMotionPlannerIn_parameter

busMotionPlannerIn_explorePath = Simulink.Bus()
  desiredRadiusX: double
  maxRadiusX: double
  maxRadiusY: double
  maxRadiusPsi: double

busMotionPlannerIn_geometry = Simulink.Bus()
  verticesVehicleShape: single[2 100]
  collisionCheckMaxPositionDeviation: double
  collisionCheckMaxAngleDeviation: double

busMotionPlannerIn_goal = Simulink.Bus()
  positionLatitude: double
  positionLongitude: double
  orientationYaw: double

busMotionPlannerIn_map = Simulink.Bus()
  vertices: single[2 8000]
  originLLA: double[3 1]

busMotionPlannerIn_maxDeviationToReset = Simulink.Bus()
  position: double
  heading: double

busMotionPlannerIn_metric = Simulink.Bus()
  weightPsi: double
  weightSway: double
  weightReverseScale: double
  weightReverseDecay: double
  distanceScale: double
  distanceDecay: double

busMotionPlannerIn_model = Simulink.Bus()
  matF: double[3 12]
  matB: double[3 3]
  vecTimeconstantsXYN: double[3 1]
  vecTimeconstantsInput: double[3 1]
  vecSatXYN: double[3 1]

busMotionPlannerIn_navigation = Simulink.Bus()
  positionLLA: double[3 1]
  orientationYaw: double
  velocityUVR: double[3 1]
  actualForceXYN: double[3 1]

busMotionPlannerIn_parameter = Simulink.Bus()
  searchRadius: double
  controlEffort: double
  explorePath: Bus: busMotionPlannerIn_explorePath
  geometry: Bus: busMotionPlannerIn_geometry
  model: Bus: busMotionPlannerIn_model
  timing: Bus: busMotionPlannerIn_timing
  metric: Bus: busMotionPlannerIn_metric

busMotionPlannerIn_timing = Simulink.Bus()
  trajectorySampletime: double
  maxComputationTimePath: double
  maxComputationTimeMotion: double

busMotionPlannerOut = Simulink.Bus()
  time: Bus: busMotionPlannerOut_time
  errorCode: uint8
  performedReset: boolean
  controlCommand: Bus: busMotionPlannerOut_controlCommand
  trajectory: Bus: busMotionPlannerOut_trajectory
  path: Bus: busMotionPlannerOut_path

busMotionPlannerOut_commandedInput = Simulink.Bus()
  tauX: double
  tauY: double
  tauN: double

busMotionPlannerOut_commandedState = Simulink.Bus()
  positionLatitude: double
  positionLongitude: double
  orientationYaw: double
  velocityU: double
  velocityV: double
  velocityR: double
  tauX: double
  tauY: double
  tauN: double

busMotionPlannerOut_controlCommand = Simulink.Bus()
  commandedState: Bus: busMotionPlannerOut_commandedState
  commandedInput: Bus: busMotionPlannerOut_commandedInput
  remainingTrajectoryDuration: double

busMotionPlannerOut_path = Simulink.Bus()
  poses: double[3 100]

busMotionPlannerOut_time = Simulink.Bus()
  timestampUTC: double
  steadyClock: double

busMotionPlannerOut_trajectory = Simulink.Bus()
  timestampSteadyClock: double
  sampletime: double
  states: double[12 500]

structMotionPlannerIn = struct(
  enablePlanner=false,
  maxDeviationToReset=struct(position=0, heading=0),
  navigation=struct(positionLLA=[0; 0; 0], orientationYaw=0, velocityUVR=[0; 0; 0], actualForceXYN=[0; 0; 0]),
  goal=struct(positionLatitude=0, positionLongitude=0, orientationYaw=0),
  map=struct(vertices=single(repmat(0, 2, 8000)), originLLA=[0; 0; 0]),
  parameter=struct(
    searchRadius=0,
    controlEffort=0,
    explorePath=struct(desiredRadiusX=0, maxRadiusX=0, maxRadiusY=0, maxRadiusPsi=0),
    geometry=struct(
      verticesVehicleShape=single(repmat(0, 2, 100)),
      collisionCheckMaxPositionDeviation=0,
      collisionCheckMaxAngleDeviation=0),
    model=struct(
      matF=repmat(0, 3, 12),
      matB=repmat(0, 3, 3),
      vecTimeconstantsXYN=[0; 0; 0],
      vecTimeconstantsInput=[0; 0; 0],
      vecSatXYN=[0; 0; 0]),
    timing=struct(trajectorySampletime=0, maxComputationTimePath=0, maxComputationTimeMotion=0),
    metric=struct(
      weightPsi=0,
      weightSway=0,
      weightReverseScale=0,
      weightReverseDecay=0,
      distanceScale=0,
      distanceDecay=0)))

structMotionPlannerOut = struct(
  time=struct(timestampUTC=0, steadyClock=0),
  errorCode=uint8(0),
  performedReset=false,
  controlCommand=struct(
    commandedState=struct(
      positionLatitude=0,
      positionLongitude=0,
      orientationYaw=0,
      velocityU=0,
      velocityV=0,
      velocityR=0,
      tauX=0,
      tauY=0,
      tauN=0),
    commandedInput=struct(tauX=0, tauY=0, tauN=0),
    remainingTrajectoryDuration=0),
  trajectory=struct(timestampSteadyClock=0, sampletime=0, states=repmat(0, 12, 500)),
  path=struct(poses=repmat(0, 3, 100)))